# Grasshopper definition Kanbar_W03_UrbanMassing.gh (Grasshopper 1.0.7)
# plug-ins: Human

crv_streets = Curve([<curve referenced from the Rhino model> x95])
pt_attractor = Point([<point referenced from the Rhino model> x3])
crv_500x500 = Curve(<curve referenced from the Rhino model>)
srf_topo = Surface(<surface referenced from the Rhino model>)
crv_coast = Curve(<curve referenced from the Rhino model>)

# ---- group: Join Streets
crv_streets_2 = Curve(crv_streets)
objatts = ObjectAttributes(ObjectOrAttributes=crv_streets_2)  # -> Name, LayerName, LayerFullPath, Color, MaterialName, LinetypeName, GroupIndices, PlotWeight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
item = ListItem(List=objatts.UserDataValues, Index=0, Wrap=True)  # -> flatten(Item)
cset = CreateSet(List=item)  # -> graft(Set), Map
equals = Equality(FirstNumber=cset.Set, SecondNumber=item)  # -> Equality, Inequality
cull = CullPattern(List=crv_streets_2, CullPattern=equals.Equality)
join = JoinCurves(Curves=cull, Preserve=False)
lng = ListLength(List=join)
dup = DuplicateData(Data=cset.Set, Number=lng, Order=True)

# ----
crv_500x500_2 = Curve(crv_500x500)
crv_coast_2 = Curve(crv_coast)

boundary = BoundarySurfaces(Edges=crv_500x500_2)
area = Area(Geometry=crv_coast_2)  # -> Area, Centroid
srfsplit = SurfaceSplit(Surface=boundary, Curves=crv_coast_2)  # -> graft(Fragments)
srf_cp = SurfaceClosestPoint(Point=area.Centroid, Surface=srfsplit)  # -> Point, UVPoint, Distance
sort = SortList(Keys=srf_cp.Distance)  # -> Keys, ValuesA
item_2 = ListItem(List=sort.Keys, Index=0, Wrap=True)
smaller = SmallerThan(FirstNumber=item_2, SecondNumber="0.1")  # -> SmallerThan, OrEqualTo
dispatch = Dispatch(List=srfsplit, DispatchPattern=smaller.SmallerThan)  # -> ListA, ListB

srf_ocean = Surface(dispatch.ListA)
srf_land = Surface(dispatch.ListB)

# ---- group: Join Streets
num_streetwidths = Number(flatten(dup))
crv_streets_3 = Curve(flatten(join))

# ---- group: Blocks
num_streetwidths_2 = Number(flatten(num_streetwidths))
crv_streets_4 = Curve(flatten(crv_streets_3))
srf_ground = Surface(flatten(srf_land))

offset = OffsetCurve(Curve=graft(crv_streets_4), Distance=expr("x/2", graft(num_streetwidths_2)), Corners=1)
offset_2 = OffsetCurve(Curve=graft(crv_streets_4), Distance=expr("-x/2", graft(num_streetwidths_2)), Corners=1)
srfsplit_2 = SurfaceSplit(Surface=srf_ground, Curves=crv_streets_4)
end = EndPoints(Curve=offset_2)  # -> Start, End
end_2 = EndPoints(Curve=offset)  # -> Start, End
graft = GraftTree(Tree=srfsplit_2, IncludeEmptyLists=True, IncludeNullItems=True)
edges = BrepEdges(Brep=graft)  # -> Naked, Interior, NonManifold
ln = Line(StartPoint=end.End, EndPoint=end_2.End)
ln_2 = Line(StartPoint=end.Start, EndPoint=end_2.Start)
join_2 = JoinCurves(Curves=edges.Naked, Preserve=False)
join_3 = JoinCurves(Curves=[offset, offset_2, ln_2, ln], Preserve=False)
flatten = FlattenTree(Tree=join_3, Path="{0}")
area_2 = Area(Geometry=join_2)  # -> Area, Centroid
srfsplit_3 = SurfaceSplit(Surface=graft, Curves=flatten)
flatten_2 = FlattenTree(Tree=area_2.Centroid, Path="{0}")
graft_2 = GraftTree(Tree=srfsplit_3, IncludeEmptyLists=True, IncludeNullItems=True)  # -> simplify(Tree)
srf_cp_2 = SurfaceClosestPoint(Point=flatten_2, Surface=graft_2)  # -> Point, UVPoint, Distance
sort_2 = SortList(Keys=srf_cp_2.Distance)  # -> Keys, ValuesA
item_3 = ListItem(List=sort_2.Keys, Index=0, Wrap=True)
smaller_2 = SmallerThan(FirstNumber=item_3, SecondNumber="0.1")  # -> SmallerThan, OrEqualTo
cull_2 = CullPattern(List=graft_2, CullPattern=smaller_2.SmallerThan)
edges_2 = BrepEdges(Brep=flatten(cull_2))  # -> Naked, Interior, NonManifold
join_4 = JoinCurves(Curves=edges_2.Naked, Preserve=False)
crv_blocks = Curve(flatten(join_4))

# ----
dispatch_2 = Dispatch(List=crv_blocks, DispatchPattern=[True, False])  # -> graft(ListA), graft(ListB)

# ---- group: Building Widths
crv_blocks_2 = Curve(simplify(graft(dispatch_2.ListA)))
pt_attractor_2 = Point(pt_attractor)
num_minwidth = Number("4")
num_maxwidth = Number("10")

# ---- group: Voronoi Buildings
num_buildingdensity = Number("100")
crv_blocks_3 = Curve(simplify(graft(dispatch_2.ListB)))

bbox = BoundingBox(Content=crv_blocks_3, Plane=PlaneXY(0, 0, 0))  # -> Box, Box_2
area_3 = Area(Geometry=bbox.Box)  # -> Area, Centroid
division = Division(A=area_3.Area, B=num_buildingdensity)
pop2d = Populate2D(Region=bbox.Box, Count=division, Seed=1)  # -> simplify(Population)
incurve = PointInCurve(Point=pop2d, Curve=crv_blocks_3)  # -> Relationship, Point
cull_3 = CullPattern(List=pop2d, CullPattern=incurve.Relationship)
voronoi = Voronoi(Points=cull_3, Boundary=bbox.Box, BruteForceOverride=False)  # -> simplify(Cells)
boundary_2 = BoundarySurfaces(Edges=voronoi)
srfsplit_4 = SurfaceSplit(Surface=boundary_2, Curves=crv_blocks_3)
path_mapper = PathMapper(srfsplit_4, source="{A;B}", target="{A}")
area_4 = Area(Geometry=path_mapper)  # -> Area, Centroid
incurve_2 = PointInCurve(Point=area_4.Centroid, Curve=crv_blocks_3)  # -> Relationship, Point
cull_4 = CullPattern(List=path_mapper, CullPattern=incurve_2.Relationship)
edges_3 = BrepEdges(Brep=cull_4)  # -> Naked, Interior, NonManifold
join_5 = JoinCurves(Curves=edges_3.Naked, Preserve=False)
reb = RebuildCurve(Curve=join_5, Degree="1", Count="4", Tangents=False)  # -> simplify(Curve)
path_mapper_2 = PathMapper(reb, source="{A;B}", target="{A}")
crv_buildingfootprints = Curve(path_mapper_2)

# ----
brep = Brep([<brep referenced from the Rhino model> x2])

# ---- group: Building Widths
area_5 = Area(Geometry=crv_blocks_2)  # -> Area, Centroid
len = Length(Curve=crv_blocks_2)

dist = Distance(PointA=area_5.Centroid, PointB=pt_attractor_2)
sort_3 = SortList(Keys=dist)  # -> Keys, ValuesA
item_4 = ListItem(List=sort_3.Keys, Index="0", Wrap=True)
bnd = Bounds(Numbers=flatten(item_4))
dom = ConstructDomain(DomainStart=num_maxwidth, DomainEnd=num_minwidth)
remap = RemapNumbers(Value=item_4, Source=bnd, Target=Domain(0, 1))  # -> Mapped, Clipped
graph = GraphMapper(
    remap.Mapped,
    x0=0,
    x1=1,
    y0=0,
    y1=1,
    container_name="Bezier",
    cpx=[0, 0.1112657934, 0.01050777733, 1],
    cpy=[0, 0.762670517, 1, 1])
remap_2 = RemapNumbers(Value=graph, Source=Domain(0, 1), Target=dom)  # -> Mapped, Clipped

division_2 = Division(A=len, B=remap_2.Mapped)
divide = DivideCurve(Curve=crv_blocks_2, Count=division_2, Kinks=False)  # -> Points, Tangents, Parameters
shift = ShiftList(List=divide.Points, Shift=1, Wrap=True)
ln_3 = Line(StartPoint=divide.Points, EndPoint=shift)
crv_buildingfronts = Curve(ln_3)

# ---- group: Building Depth
num_maxdepth = Number("12")
crv_streets_5 = Curve(flatten(crv_streets_3))
crv_buildingfronts_2 = Curve(simplify(graft(crv_buildingfronts)))
pt_attractor_3 = Point(pt_attractor)
num_mindepth = Number("5")

midpt = CurveMiddle(Curve=crv_buildingfronts_2)
crv_cp = CurveClosestPoint(Point=midpt, Curve=crv_streets_5)  # -> Point, Parameter, Distance
sort_4 = SortList(Keys=crv_cp.Distance, ValuesA=crv_cp.Point)  # -> Keys, ValuesA
item_5 = ListItem(List=sort_4.ValuesA, Index=0, Wrap=True)
vec2pt = Vector2Pt(PointA=item_5, PointB=midpt, Unitize=False)  # -> Vector, Length
end_3 = EndPoints(Curve=crv_buildingfronts_2)  # -> Start, End

dist_2 = Distance(PointA=midpt, PointB=pt_attractor_3)
sort_5 = SortList(Keys=dist_2)  # -> Keys, ValuesA
item_6 = ListItem(List=sort_5.Keys, Index="0", Wrap=True)
bnd_2 = Bounds(Numbers=flatten(item_6))
dom_2 = ConstructDomain(DomainStart=num_maxdepth, DomainEnd=num_mindepth)
remap_3 = RemapNumbers(Value=item_6, Source=bnd_2, Target=Domain(0, 1))  # -> Mapped, Clipped
graph_2 = GraphMapper(
    remap_3.Mapped,
    x0=0,
    x1=1,
    y0=0,
    y1=1,
    container_name="Bezier",
    cpx=[0, 0.4055331647, 0, 1],
    cpy=[0, 0.1889086962, 1, 1])
remap_4 = RemapNumbers(Value=graph_2, Source=Domain(0, 1), Target=dom_2)  # -> Mapped, Clipped

amp = Amplitude(Vector=vec2pt.Vector, Amplitude=remap_4.Mapped)
move = Move(Geometry=crv_buildingfronts_2, Motion=amp)  # -> Geometry, Transform
end_4 = EndPoints(Curve=move.Geometry)  # -> Start, End
merge = Merge(Data1=end_3.Start, Data2=end_3.End, Data3=end_4.End, Data4=end_4.Start)
pline = PolyLine(Vertices=merge, Closed=True)
path_mapper_3 = PathMapper(pline, source="{A;B}", target="{A}")
crv_buildingfootprints_2 = Curve(path_mapper_3)

# ---- group: Topography Footprints
crv_buildingfootprints_3 = Curve([crv_buildingfootprints_2, crv_buildingfootprints])
srf_topo_2 = Surface(srf_topo)

cp = ControlPoints(Curve=crv_buildingfootprints_3)  # -> Points, Weights, Knots
Z = UnitZ(Factor=1)
line = LineSDL(Start=cp.Points, Direction=Z, Length=1)
slx = SurfaceLine(Surface=srf_topo_2, Line=line, LimitToFirst=False)  # -> Curves, Points, UVPoints, Normal
path_mapper_4 = PathMapper(slx.Points, source="{A;B;C}", target="{A;B}")
pdecon = Deconstruct(Point=path_mapper_4)  # -> XComponent, YComponent, ZComponent
sort_6 = SortList(Keys=pdecon.ZComponent, ValuesA=path_mapper_4, ValuesB=cp.Points)  # -> Keys, ValuesA, ValuesB
item_7 = ListItem(List=sort_6.ValuesA, Index=0, Wrap=True)
item_8 = ListItem(List=sort_6.ValuesB, Index=0, Wrap=True)
vec2pt_2 = Vector2Pt(PointA=item_8, PointB=item_7, Unitize=False)  # -> Vector, Length
path_mapper_5 = PathMapper(vec2pt_2.Vector, source="{A;B}", target="{A}")
move_2 = Move(Geometry=crv_buildingfootprints_3, Motion=path_mapper_5)  # -> Geometry, Transform
crv_buildingfootprints_4 = Curve(move_2.Geometry)

# ---- group: Building Height
crv_buildingfootprints_5 = Curve(crv_buildingfootprints_4)
num_maxheight = Number("20")
num_maxadjust = Number("2")
pt_attractor_4 = Point(pt_attractor)
num_minheight = Number("4")
num_minadjust = Number("0.9")

pcen = PolygonCenter(Polyline=crv_buildingfootprints_5)  # -> CenterV, CenterE, CenterA
avr = Average(Input=pcen.CenterV)
lng_2 = ListLength(List=crv_buildingfootprints_5)
dom_3 = ConstructDomain(DomainStart=num_minadjust, DomainEnd=num_maxadjust)
range = Range(Domain=dom_3, Steps=expr("x-1", lng_2))
jitter = Jitter(List=range, Jitter=1, Seed=2)  # -> Values, Indices

dist_3 = Distance(PointA=avr, PointB=pt_attractor_4)
sort_7 = SortList(Keys=dist_3)  # -> Keys, ValuesA
item_9 = ListItem(List=sort_7.Keys, Index="0", Wrap=True)
bnd_3 = Bounds(Numbers=flatten(item_9))
dom_4 = ConstructDomain(DomainStart=num_maxheight, DomainEnd=num_minheight)
remap_5 = RemapNumbers(Value=item_9, Source=bnd_3, Target=Domain(0, 1))  # -> Mapped, Clipped
graph_3 = GraphMapper(
    remap_5.Mapped,
    x0=0,
    x1=1,
    y0=0,
    y1=1,
    container_name="Bezier",
    cpx=[0, 0.1778936684, 0, 1],
    cpy=[0, 0.5957272053, 1, 1])
remap_6 = RemapNumbers(Value=graph_3, Source=Domain(0, 1), Target=dom_4)  # -> Mapped, Clipped

Z_2 = UnitZ(Factor=remap_6.Mapped)
dup_2 = DuplicateData(Data=Z_2, Number=lng_2, Order=True)
multiplication = Multiplication(A=jitter.Values, B=dup_2)

cp_2 = ControlPoints(Curve=crv_buildingfootprints_5)  # -> Points, Weights, Knots
vec_height = Vector(simplify(graft(multiplication)))
item_10 = ListItem(List=cp_2.Points, Index="2", Wrap=True)
item_11 = ListItem(List=cp_2.Points, Index="3", Wrap=True)
item_12 = ListItem(List=cp_2.Points, Index="0", Wrap=True)
item_13 = ListItem(List=cp_2.Points, Index="1", Wrap=True)
move_3 = Move(Geometry=item_12, Motion=vec_height)  # -> Geometry, Transform
move_4 = Move(Geometry=item_10, Motion=vec_height)  # -> Geometry, Transform
move_5 = Move(Geometry=item_13, Motion=vec_height)  # -> Geometry, Transform
move_6 = Move(Geometry=item_11, Motion=vec_height)  # -> Geometry, Transform
tbox = TwistedBox(
    CornerA=item_12,
    CornerB=item_13,
    CornerC=item_10,
    CornerD=item_11,
    CornerE=move_3.Geometry,
    CornerF=move_5.Geometry,
    CornerG=move_4.Geometry,
    CornerH=move_6.Geometry)

geo_buildingenvelope = Geometry(tbox)
mesh = Mesh(tbox)

# ----
brep_2 = Brep(graft(geo_buildingenvelope))
bbox_2 = BoundingBox(Content=brep_2, Plane=PlaneXY(0, 0, 0))  # -> Box, Box_2
debox = DeconstructBox(Box=bbox_2.Box)  # -> Plane, X, Y, Z
dedomain = DeconstructDomain(Domain=debox.Z)  # -> Start, End
dedomain_2 = DeconstructDomain(Domain=debox.X)  # -> Start, End
dedomain_3 = DeconstructDomain(Domain=debox.Y)  # -> Start, End
subtraction = Subtraction(A=dedomain.End, B=dedomain.Start)
division_3 = Division(A=subtraction, B="4")
int = Integer(division_3)
division_4 = Division(A=subtraction, B=int)
division_5 = Division(A=division_4, B="2")
addition = Addition(A=dedomain.Start, B=division_5)
mesh_2 = MeshBrep(
    Brep=brep_2,
    Settings={GridMaxCount=0, GridMinCount=16, JaggedSeams=False, MaxEdgeLength=0, MinEdgeLength=0.0001, MinTolerance=0, Refine=True, RefineAngle=0, RelativeTolerance=0.65, SimplePlanes=True, Tolerance=0})
pt = ConstructPoint(XCoordinate=dedomain_2.Start, YCoordinate=dedomain_3.Start, ZCoordinate=addition)
box = CenterBox(Base=pt, X=division_5, Y=division_5, Z=division_5)
boxmap = BoxMapping(Mesh=mesh_2, Box=box)
path = FilePath("C:\Users\mconway\Downloads\UCLA\testtexture.PNG")
previewmat = CustomPreviewMaterials(Geometry=boxmap, DiffuseColor=RGB(255, 255, 255), DiffuseBitmap=path)
mesh_mappedenvelope = Mesh(boxmap)
